# Grasshopper definition Cool Design.gh (Grasshopper 0.9.76)

pipe_radius = Slider(0.05, range=0..1)
pipe_cap = BooleanToggle(True)
geo = Geometry(<brep referenced from the Rhino model>)
show_surface = BooleanToggle(False)
show_design = BooleanToggle(False)
second_layer_offset = Slider(0.2, range=-2..2)
wrap_u_pipes = BooleanToggle(True)
wrap_v_pipes = BooleanToggle(True)
u_division = Slider(12, range=0..20)
v_division = Slider(12, range=0..20)
third_layer_offset = Slider(0, range=-2..2)
gate = StreamGate(Stream=geo, Gate=show_design)  # -> Target0, Target1
surface_to_design = SurfaceToDesign(
    surface=gate.Target1,
    second_layer_offset=second_layer_offset,
    third_layer_offset=third_layer_offset,
    wrap_u_pipes=wrap_u_pipes,
    wrap_v_pipes=wrap_v_pipes,
    u_division=u_division,
    v_division=v_division)
pipe = Pipe(Curve=surface_to_design, Radius=pipe_radius, Caps=pipe_cap)

# ==== cluster SurfaceToDesign
second_layer_offset = ClusterInput()
third_layer_offset = ClusterInput()
wrap_u_pipes = ClusterInput()
wrap_v_pipes = ClusterInput()
u_division = ClusterInput()
v_division = ClusterInput()
second_layer_offset_2 = Number(second_layer_offset)
third_layer_offset_2 = Number(third_layer_offset)
wrap_u_pipes_2 = Boolean(wrap_u_pipes)
wrap_v_pipes_2 = Boolean(wrap_v_pipes)
u_division_2 = Integer(u_division)
v_division_2 = Integer(v_division)
surface = ClusterInput()
int = Integer(0)
equals = Equality(FirstNumber=second_layer_offset_2, SecondNumber=int)  # -> Equality, Inequality
surface_2 = Geometry(surface)
addition = Addition(A=second_layer_offset_2, B=third_layer_offset_2)
int_2 = Integer(0)
gate = StreamGate(Stream=surface_2, Gate=equals.Equality)  # -> Target0, Target1
equals_2 = Equality(FirstNumber=second_layer_offset_2, SecondNumber=int_2)  # -> Equality, Inequality
gate_2 = StreamGate(Stream=[surface_2, gate.Target1], Gate=equals_2.Equality)  # -> Target0, Target1
offset = Offset(Surface=gate_2.Target0, Distance=second_layer_offset_2, Retrim=True)
offset_2 = Offset(Surface=gate.Target0, Distance=addition, Retrim=True)
sdivide = DivideSurface(Surface=surface_2, UCount=u_division_2, VCount=v_division_2)  # -> Points, Normals, Parameters
sdivide_2 = DivideSurface(Surface=offset, UCount=u_division_2, VCount=v_division_2)  # -> Points, Normals, Parameters
sdivide_3 = DivideSurface(Surface=offset_2, UCount=u_division_2, VCount=v_division_2)  # -> Points, Normals, Parameters
relitem = RelativeItem(Tree=sdivide.Points, Offset="{0;0;0}(1)", WrapPaths=wrap_u_pipes_2, WrapItems=wrap_v_pipes_2)  # -> ItemA, ItemB
relitem_2 = RelativeItem(Tree=sdivide.Points, Offset="{0;0;+1}(0)", WrapPaths=wrap_u_pipes_2, WrapItems=wrap_v_pipes_2)  # -> ItemA, ItemB
relitem_3 = RelativeItem(Tree=sdivide.Points, Offset="{0;0;-1}(0)", WrapPaths=wrap_u_pipes_2, WrapItems=wrap_v_pipes_2)  # -> ItemA, ItemB
relitem_4 = RelativeItem(Tree=sdivide_2.Points, Offset="{0;0;0}(1)", WrapPaths=wrap_u_pipes_2, WrapItems=wrap_v_pipes_2)  # -> ItemA, ItemB
relitem_5 = RelativeItem(Tree=sdivide_2.Points, Offset="{0;0;+1}(0)", WrapPaths=wrap_u_pipes_2, WrapItems=wrap_v_pipes_2)  # -> ItemA, ItemB
relitem_6 = RelativeItem(Tree=sdivide_2.Points, Offset="{0;0;-1}(0)", WrapPaths=wrap_u_pipes_2, WrapItems=wrap_v_pipes_2)  # -> ItemA, ItemB
relitem_7 = RelativeItem(Tree=sdivide_3.Points, Offset="{0;0;0}(1)", WrapPaths=wrap_u_pipes_2, WrapItems=wrap_v_pipes_2)  # -> ItemA, ItemB
relitem_8 = RelativeItem(Tree=sdivide_3.Points, Offset="{0;0;+1}(0)", WrapPaths=wrap_u_pipes_2, WrapItems=wrap_v_pipes_2)  # -> ItemA, ItemB
relitem_9 = RelativeItem(Tree=sdivide_3.Points, Offset="{0;0;-1}(0)", WrapPaths=wrap_u_pipes_2, WrapItems=wrap_v_pipes_2)  # -> ItemA, ItemB
ln = Line(StartPoint=relitem.ItemA, EndPoint=relitem.ItemB)
ln_2 = Line(StartPoint=relitem.ItemA, EndPoint=relitem_2.ItemB)
ln_3 = Line(StartPoint=relitem_4.ItemA, EndPoint=relitem_4.ItemB)
ln_4 = Line(StartPoint=relitem_4.ItemA, EndPoint=relitem_5.ItemB)
ln_5 = Line(StartPoint=relitem_7.ItemA, EndPoint=relitem_7.ItemB)
ln_6 = Line(StartPoint=relitem_7.ItemA, EndPoint=relitem_8.ItemB)
ln_7 = Line(StartPoint=relitem.ItemA, EndPoint=relitem_4.ItemA)
ln_8 = Line(StartPoint=relitem.ItemB, EndPoint=relitem_5.ItemB)
ln_9 = Line(StartPoint=relitem.ItemB, EndPoint=relitem_6.ItemB)
ln_10 = Line(StartPoint=relitem_3.ItemB, EndPoint=relitem_4.ItemB)
ln_11 = Line(StartPoint=relitem_2.ItemB, EndPoint=relitem_4.ItemB)
ln_12 = Line(StartPoint=relitem_4.ItemA, EndPoint=relitem_7.ItemA)
ln_13 = Line(StartPoint=relitem_5.ItemB, EndPoint=relitem_8.ItemB)
ln_14 = Line(StartPoint=relitem_4.ItemB, EndPoint=relitem_9.ItemB)
ln_15 = Line(StartPoint=relitem_6.ItemB, EndPoint=relitem_7.ItemB)
ln_16 = Line(StartPoint=relitem_5.ItemB, EndPoint=relitem_7.ItemB)
line = Line([ln, ln_2, ln_3, ln_4, ln_7, ln_8, ln_9, ln_10, ln_11, ln_5, ln_12, ln_6, ln_13, ln_14, ln_15, ln_16])
line_2 = ClusterOutput(line)
