# Grasshopper definition Grasshopper Equations.gh (Grasshopper 1.0.4)

# Ibrahim Mahmoud
# 
# 7/11/17 - Created equation generation component
# 
# 7/12/17 - Added design feature
# 
# 7/18/17 - Added 4D equation feature
lower_x_bound = Slider(-6.28, range=-50..50)
upper_x_bound = Slider(6.28, range=-50..50)
lower_y_bound = Slider(-3.142, range=-50..50.001)
upper_y_bound = Slider(3.142, range=-50..50)
lower_4d_bound = Slider(-6, range=-50..50.001)
upper_4d_bound = Slider(6, range=-50..50)
curves_per_surface = Slider(50, range=0..100)
points_per_curve = Slider(200, range=0..500)
_4d_frames = Slider(50, range=0..500)
_4d_variable = Slider(1, range=-50..50)
a_variable = Slider(1, range=-50..50)
b_variable = Slider(1, range=-50..50)
c_variable = Slider(0, range=-50..50)
d_variable = Slider(0, range=0..6.282)
panel = Panel("z = a*cos(b*x*x+c*y*y + d)")
panel_2 = Panel("z = a * (sin(x + d)+sin(y + d))")
panel_3 = Panel("r = a * pow((4/3) + b, c*theta*sin(phi + d))")
panel_4 = Panel("r = cos(phi*d)*cos(phi*d)")
list = ValueList({"4D Animation": 0, "4D Generalization": 1}, selected="4D Animation")
close_u_curves = BooleanToggle(True)
close_v_curves = BooleanToggle(False)
list_2 = ValueList({"2D": 0, "3D": 1, "4D": 2}, selected="2D")
show_equation = BooleanToggle(True)
equation_to_surface = CSharpScript(
    a=list_2,
    b=lower_x_bound,
    c=upper_x_bound,
    d=lower_y_bound,
    e=upper_y_bound,
    f=lower_4d_bound,
    g=upper_4d_bound,
    h=curves_per_surface,
    i=points_per_curve,
    j=_4d_frames,
    k=close_u_curves,
    l=close_v_curves,
    m=list,
    n="y = a * sin( b * x + c ) + d",
    o=_4d_variable,
    p=a_variable,
    q=b_variable,
    r=c_variable,
    s=d_variable,
    Reference="C:\USERS\IXMIB\DOCUMENTS\PLUGIN\PLOTEQUATION 64-BIT\PLOTEQUATION\BIN\NCalc.dll")  # -> out, A
# ---------- equation_to_surface: C# ----------
    bool is3D = (int) a == 1 || (int) a == 2;
    bool is4D = (int) a == 2;
    double minOne = (double) b;
    double maxOne = (double) c;
    double minTwo = (double) d;
    double maxTwo = (double) e;
    double min4D = (double) f;
    double max4D = (double) g;
    double curvesPerSurface = (double) h;
    double pointsPerCurve = (double) i;
    double frames4D = (double) j;
    bool closeU = (bool) k;
    bool closeV = (bool) l;
    bool animation4D = (int) m == 1;
    string equation = ((string) n).ToLower().Replace(" ", "").Trim();
    double fourValue = (double) o;
    double aValue = (double) p;
    double bValue = (double) q;
    double cValue = (double) r;
    double dValue = (double) s;

    ExpressionType type = ExpressionType.NONE;

    if (equation.IndexOf("x") != -1 || equation.IndexOf("y") != -1 || (equation.IndexOf("z") != -1 && equation.IndexOf("theta") == -1 && equation.IndexOf("phi") == -1 && equation.IndexOf("r") == -1))
      type = ExpressionType.CARTESIAN;
    else if ((equation.IndexOf("theta") != -1 || equation.IndexOf("phi") != -1) && (equation.IndexOf("r") != -1 || equation.IndexOf("z") == -1))
      type = ExpressionType.POLAR;
    else
      type = ExpressionType.CYLINDRICAL;

    string simplifiedEq = equation.Substring(equation.IndexOf('=') + 1);
    string one = null;
    string two = null;
    string three = null;
    string four = null;
    string aVar = "A";
    string bVar = "B";
    string cVar = "C";
    string dVar = "D";

    if (IsValid(new Expression(equation)) && maxOne > minOne && maxTwo > minTwo)
    {
      switch (type)
      {
        case ExpressionType.POLAR:
          one = "Theta";
          two = "Phi";
          three = "R";
          four = "S";
          break;
        case ExpressionType.CYLINDRICAL:
          one = "Theta";
          two = "Z";
          three = "R";
          four = "S";
          break;
        default:
          one = "X";
          two = "Y";
          three = "Z";
          four = "W";
          break;
      }

      bool oneExists = false;
      bool twoExists = false;
      bool threeExists = false;
      bool fourExists = false;
      bool aExists = false;
      bool bExists = false;
      bool cExists = false;
      bool dExists = false;
      bool equalsExists = false;

      one = one.ToLower();
      two = two.ToLower();
      three = three.ToLower();
      four = four.ToLower();
      aVar = aVar.ToLower();
      bVar = bVar.ToLower();
      cVar = cVar.ToLower();
      dVar = dVar.ToLower();
      
      oneExists |= simplifiedEq.IndexOf(one, StringComparison.Ordinal) != -1;
      twoExists |= simplifiedEq.IndexOf(two, StringComparison.Ordinal) != -1;
      threeExists |= simplifiedEq.IndexOf(three, StringComparison.Ordinal) != -1;
      fourExists |= simplifiedEq.IndexOf(four, StringComparison.Ordinal) != -1;
      aExists |= simplifiedEq.IndexOf(aVar, StringComparison.Ordinal) != -1;
      bExists |= simplifiedEq.IndexOf(bVar, StringComparison.Ordinal) != -1;
      cExists |= simplifiedEq.IndexOf(cVar, StringComparison.Ordinal) != -1;
      dExists |= simplifiedEq.IndexOf(dVar, StringComparison.Ordinal) != -1;
      equalsExists |= equation.IndexOf('=') != -1;

      simplifiedEq += "+0*" + four + "*" + aVar + "*" + bVar + "*" + cVar + "*" + dVar;
      VariablesUsed func = VariablesUsed.NONE;

      if (((oneExists || twoExists || fourExists || aExists || bExists || cExists || dExists || HasRightVariables(equation, one, two, four, aVar, bVar, cVar, dVar)) && (equation.StartsWith(three + "=", StringComparison.Ordinal) || equation.StartsWith("f(" + one + "," + two + ")=", StringComparison.Ordinal) || !equalsExists)) && HasRightVariables(equation, one, two, four, aVar, bVar, cVar, dVar))
      {
        simplifiedEq += "*" + one + "*" + two;
        func = VariablesUsed.ONE_TWO;
      }
      else if (((twoExists || threeExists || fourExists || aExists || bExists || cExists || dExists || HasRightVariables(equation, two, three, four, aVar, bVar, cVar, dVar)) && (equation.StartsWith(one + "=", StringComparison.Ordinal) || equation.StartsWith("f(" + two + "," + three + ")=", StringComparison.Ordinal) || !equalsExists)) && HasRightVariables(equation, two, three, four, aVar, bVar, cVar, dVar))
      {
        simplifiedEq += "*" + two + "*" + three;
        func = VariablesUsed.TWO_THREE;
      }
      else if (((oneExists || threeExists || fourExists || aExists || bExists || cExists || dExists || HasRightVariables(equation, one, three, four, aVar, bVar, cVar, dVar)) && (equation.StartsWith(two + "=", StringComparison.Ordinal) || equation.StartsWith("f(" + one + "," + three + ")=", StringComparison.Ordinal) || !equalsExists)) && HasRightVariables(equation, one, three, four, aVar, bVar, cVar, dVar))
      {
        simplifiedEq += "*" + one + "*" + three;
        func = VariablesUsed.ONE_THREE;
      }

      Print(simplifiedEq);Print(type.ToString());Print(func.ToString());

      Expression eq = new Expression(simplifiedEq);
      SetParameters(ref eq);

      switch (type)
      {
        case ExpressionType.CARTESIAN:
          switch (func)
          {
            case VariablesUsed.TWO_THREE:
              one = "y";
              two = "z";
              break;
            case VariablesUsed.ONE_THREE:
              one = "x";
              two = "z";
              break;
            default:
              one = "x";
              two = "y";
              break;
          }

          break;
        case ExpressionType.POLAR:
          switch (func)
          {
            case VariablesUsed.TWO_THREE:
              one = "phi";
              two = "r";
              break;
            case VariablesUsed.ONE_THREE:
              one = "theta";
              two = "r";
              break;
            default:
              one = "theta";
              two = "phi";
              break;
          }

          break;
        case ExpressionType.CYLINDRICAL:
          switch (func)
          {
            case VariablesUsed.TWO_THREE:
              one = "z";
              two = "r";
              break;
            case VariablesUsed.ONE_THREE:
              one = "theta";
              two = "r";
              break;
            default:
              one = "theta";
              two = "z";
              break;
          }

          break;
      }

      double curveIteration = (maxTwo - minTwo) / curvesPerSurface;
      double pointIteration = (maxOne - minOne) / pointsPerCurve;
      double iteration4D = (max4D - min4D) / frames4D;
      double result = 0;
      List<Point3d> curve = new List<Point3d>();
      List<Point3d> points = new List<Point3d>();
      List<List<Point3d>> surface = new List<List<Point3d>>();
      List<NurbsSurface> frames = new List<NurbsSurface>();

      eq.Parameters[four] = fourValue;
      eq.Parameters[aVar] = aValue;
      eq.Parameters[bVar] = bValue;
      eq.Parameters[cVar] = cValue;
      eq.Parameters[dVar] = dValue;

      if (!is3D)
      {
        string temp = one;

        one = two;
        two = temp;

        double tmp = minOne;

        minOne = minTwo;
        minTwo = tmp;
        maxTwo = maxOne;

        maxOne = minOne + 1;
        curveIteration = 2;
      }
      if (!is4D)
      {
        min4D = 1;
        max4D = 1;
        iteration4D = 2;
      }
      //Print(one + " " + two + " " + minOne + " " + maxOne + " " + minTwo + " " + maxTwo + " " + curveIteration + " " + pointIteration);

      int curveDecimalCount = DecimalCount(curveIteration);
      int pointDecimalCount = DecimalCount(pointIteration);
      int fourDecimalCount = DecimalCount(iteration4D);

      for (double var4D = min4D; var4D <= max4D; var4D += iteration4D)
      {
        eq.Parameters[four] = Math.Round(var4D, fourDecimalCount);

        for (double varOne = minOne; varOne <= maxOne; varOne += curveIteration)
        {
          eq.Parameters[one] = Math.Round(varOne, curveDecimalCount);

          for (double varTwo = minTwo; varTwo < maxTwo; varTwo += pointIteration)
          {
            eq.Parameters[two] = Math.Round(varTwo, pointDecimalCount);

            result = Convert.ToDouble(eq.Evaluate());

            if (Double.IsPositiveInfinity(result))
              result = Double.MaxValue;
            else if (Double.IsNegativeInfinity(result))
              result = Double.MinValue;
            else if (Double.IsNaN(result))
              result = 0;

            curve.Add(EvaluateFunction(eq, type, func, is3D ? varOne : varTwo, is3D ? varTwo : varOne, result));
          }

          if (closeV)
            curve.Add(curve[0]);

          surface.Add(curve);
          curve = new List<Point3d>();
        }

        if (closeU)
          surface.Add(surface[0]);

        if (is3D)
        {
          foreach (List<Point3d> list in surface)
            points.AddRange(list);
          /*
          Print("\nvar4D: " + var4D);
          Print("points.Count: " + points.Count);
          Print("surface.Count: " + surface.Count);
          Print("surface[0].Count: " + surface[0].Count);
          */
          NurbsSurface srf = NurbsSurface.CreateFromPoints(points, surface.Count, surface[0].Count, 3, 3);

          if (is4D)
            frames.Add(srf);
          else
            A = srf;
        }
        else
          A = Curve.CreateInterpolatedCurve(surface[0], 3);
      }

      if (is4D)
        A = frames;
    }
# ---------- equation_to_surface: C# additional code ----------
  public enum ExpressionType
  {
    NONE = 0, CARTESIAN, POLAR, CYLINDRICAL
  }

  public enum VariablesUsed
  {
    NONE = 0, ONE, TWO, PARAMETRIC_CURVE, IMPLICIT_CURVE, ONE_TWO, TWO_THREE, ONE_THREE, PARAMETRIC_SURFACE, IMPLICIT_SURFACE
  }

  private int DecimalCount(double val)
  {
    int i = 0;

    while (!Math.Round(val, i).Equals(val) && i < 14)
      i++;

    return i;
  }

  private Point3d CartesianPoint(double x, double y, double z = 0)
  {
    return new Point3d(x, y, z);
  }

  private Point3d PolarPoint(double theta, double phi, double r)
  {
    return new Point3d(r * Math.Cos(theta) * Math.Sin(phi), r * Math.Sin(theta) * Math.Sin(phi), r * Math.Cos(phi));
  }

  private Point3d CylindricalPoint(double theta, double z, double r)
  {
    return new Point3d(r * Math.Cos(theta), r * Math.Sin(theta), z);
  }

  private Point3d EvaluateFunction(Expression eq, ExpressionType type, VariablesUsed func, double x, double y, double z)
  {
    switch (type)
    {
      case ExpressionType.CARTESIAN:
        switch (func)
        {
          case VariablesUsed.ONE_TWO:
            return CartesianPoint(x, y, z);
          case VariablesUsed.ONE_THREE:
            return CartesianPoint(x, z, y);
          case VariablesUsed.TWO_THREE:
            return CartesianPoint(z, x, y);
        }

        break;
      case ExpressionType.POLAR:
        switch (func)
        {
          case VariablesUsed.ONE_TWO:
            return PolarPoint(x, y, z);
          case VariablesUsed.ONE_THREE:
            return PolarPoint(x, z, y);
          case VariablesUsed.TWO_THREE:
            return PolarPoint(z, x, y);
        }

        break;
      case ExpressionType.CYLINDRICAL:
        switch (func)
        {
          case VariablesUsed.ONE_TWO:
            return CylindricalPoint(x, y, z);
          case VariablesUsed.ONE_THREE:
            return CylindricalPoint(x, z, y);
          case VariablesUsed.TWO_THREE:
            return CylindricalPoint(z, x, y);
        }

        break;
    }

    return Point3d.Origin;
  }

  private bool IsValid(Expression e)
  {
    if (e.HasErrors())
    {
      Print(e.Error);
      return false;
    }

    return true;
  }

  private void RemoveMathFunctions(ref string eq)
  {
    eq = eq.Replace("ieeeremainder(", "");
    eq = eq.Replace("remainder(", "");
    eq = eq.Replace("truncate(", "");
    eq = eq.Replace("randdec(", "");
    eq = eq.Replace("randint(", "");
    eq = eq.Replace("ceiling(", "");
    eq = eq.Replace("random(", "");
    eq = eq.Replace("round(", "");
    eq = eq.Replace("floor(", "");
    eq = eq.Replace("log10(", "");
    eq = eq.Replace("asin(", "");
    eq = eq.Replace("acos(", "");
    eq = eq.Replace("atan(", "");
    eq = eq.Replace("sinh(", "");
    eq = eq.Replace("cosh(", "");
    eq = eq.Replace("tanh(", "");
    eq = eq.Replace("csch(", "");
    eq = eq.Replace("sech(", "");
    eq = eq.Replace("coth(", "");
    eq = eq.Replace("sinc(", "");
    eq = eq.Replace("sign(", "");
    eq = eq.Replace("sqrt(", "");
    eq = eq.Replace("rand", "");
    eq = eq.Replace("abs(", "");
    eq = eq.Replace("pow(", "");
    eq = eq.Replace("min(", "");
    eq = eq.Replace("max(", "");
    eq = eq.Replace("exp(", "");
    eq = eq.Replace("log(", "");
    eq = eq.Replace("sin(", "");
    eq = eq.Replace("cos(", "");
    eq = eq.Replace("tan(", "");
    eq = eq.Replace("csc(", "");
    eq = eq.Replace("sec(", "");
    eq = eq.Replace("cot(", "");
    eq = eq.Replace("ln(", "");
    eq = eq.Replace("pi", "");
  }

  private bool CheckForBadVar(char[] eq)
  {
    foreach (char c in eq)
      if ((int) c != 101 && ((int) c >= 97 && (int) c <= 122))
        return true;

    return false;
  }

  private bool HasRightVariables(string equation, string a, string b = "", string c = "", string d = "", string e = "", string f = "", string g = "")
  {
    if (equation.Length == 0)
      return false;

    equation = equation.Substring(equation.IndexOf('=') + 1);

    RemoveMathFunctions(ref equation);

    if (equation.IndexOf(a, StringComparison.Ordinal) != -1 && a != "")
      equation = equation.Replace(a, "");
    if (equation.IndexOf(b, StringComparison.Ordinal) != -1 && b != "")
      equation = equation.Replace(b, "");
    if (equation.IndexOf(c, StringComparison.Ordinal) != -1 && c != "")
      equation = equation.Replace(c, "");
    if (equation.IndexOf(d, StringComparison.Ordinal) != -1 && d != "")
      equation = equation.Replace(d, "");
    if (equation.IndexOf(e, StringComparison.Ordinal) != -1 && e != "")
      equation = equation.Replace(e, "");
    if (equation.IndexOf(f, StringComparison.Ordinal) != -1 && f != "")
      equation = equation.Replace(f, "");
    if (equation.IndexOf(g, StringComparison.Ordinal) != -1 && g != "")
      equation = equation.Replace(g, "");
    if (equation.Length != 0)
      return !CheckForBadVar(equation.ToCharArray());

    return true;
  }

  private void SetParameters(ref Expression expression)
  {
    expression.Parameters["pi"] = Math.PI;
    expression.Parameters["e"] = Math.E;

    expression.EvaluateFunction += delegate (string name, FunctionArgs args)
      {
        double d = Double.NaN,
          e = Double.NaN,
          f = Double.NaN;

        if (args.Parameters.Length > 0)
          d = Convert.ToDouble(args.Parameters[0].Evaluate());
        if (args.Parameters.Length > 1)
          e = Convert.ToDouble(args.Parameters[1].Evaluate());
        if (args.Parameters.Length > 2)
          f = Convert.ToDouble(args.Parameters[2].Evaluate());

        if (name == "abs")
          args.Result = Math.Abs(d);
        else if (name == "pow")
          args.Result = Math.Pow(d, e);
        else if (name == "sqrt")
          args.Result = Math.Sqrt(d);
        else if (name == "round")
          args.Result = Math.Round(d, Convert.ToInt32(e));
        else if (name == "sign")
        {
          if (d > 0)
            args.Result = 1;
          else if (d < 0)
            args.Result = -1;
          else
            args.Result = 0;
        }
        else if (name == "min")
          args.Result = Math.Min(d, e);
        else if (name == "max")
          args.Result = Math.Max(d, e);
        else if (name == "ceiling")
          args.Result = Math.Ceiling(d);
        else if (name == "truncate")
          args.Result = Math.Truncate(d);
        else if (name == "exp")
          args.Result = Math.Exp(d);
        else if (name == "floor")
          args.Result = Math.Floor(d);
        else if (name == "remainder" || name == "ieeeremainder")
          args.Result = Math.IEEERemainder(d, e);
        else if (name == "ln")
          args.Result = Math.Log(d);
        else if (name == "log")
          if (Double.IsNaN(e))
            args.Result = Math.Log10(d);
          else
            args.Result = Math.Log10(e) / Math.Log10(d);
        else if (name == "log10")
          args.Result = Math.Log10(d);
        else if (name == "sin")
          args.Result = Math.Sin(d % (2 * Math.PI));
        else if (name == "cos")
          args.Result = Math.Cos(d % (2 * Math.PI));
        else if (name == "tan")
          args.Result = Math.Tan(d % (2 * Math.PI));
        else if (name == "csc")
          args.Result = 1 / Math.Sin(d % (2 * Math.PI));
        else if (name == "sec")
          args.Result = 1 / Math.Cos(d % (2 * Math.PI));
        else if (name == "cot")
          args.Result = 1 / Math.Tan(d % (2 * Math.PI));
        else if (name == "asin")
          args.Result = Math.Asin(d % (2 * Math.PI));
        else if (name == "acos")
          args.Result = Math.Acos(d % (2 * Math.PI));
        else if (name == "atan")
          args.Result = Math.Atan(d % (2 * Math.PI));
        else if (name == "sinh")
          args.Result = Math.Sinh(d);
        else if (name == "cosh")
          args.Result = Math.Cosh(d);
        else if (name == "tanh")
          args.Result = Math.Tanh(d);
        else if (name == "csch")
          args.Result = 1 / Math.Sinh(d);
        else if (name == "sech")
          args.Result = 1 / Math.Cosh(d);
        else if (name == "coth")
          args.Result = 1 / Math.Tanh(d);
        else if (name == "sinc")
          if (Equals(d, 0))
            args.Result = 1;
          else
            args.Result = Math.Sin(d % (2 * Math.PI)) / d;
        else if (name == "random")
        {
          var random = new Random((int) DateTime.Now.Ticks & 0x0000FFFF);

          if (Double.IsNaN(d))
            d = 1;

          args.Result = random.NextDouble() * d;
        }
        else if (name == "randint")
        {
          var random = new Random((int) DateTime.Now.Ticks & 0x0000FFFF);

          if (d < e)
            args.Result = (int) d + (int) ((e - d + 1) * random.NextDouble());
          else
            args.Result = (int) e + (int) ((d - e + 1) * random.NextDouble());
        }
        else if (name == "randdec")
        {
          var random = new Random((int) DateTime.Now.Ticks & 0x0000FFFF);

          if (d < e)
            args.Result = d + (e - d + 1) * random.NextDouble();
          else
            args.Result = e + (d - e + 1) * random.NextDouble();
        }
      };
  }
# ---------- end equation_to_surface ----------
panel_5 = Panel(equation_to_surface.out)
gate = StreamGate(Stream=equation_to_surface.A, Gate=show_equation)  # -> Target0, Target1
geo = Geometry(gate.Target1)
