# Grasshopper definition Torus Design.gh (Grasshopper 0.9.76)

tube_radius = Slider(0.48, range=0..10)
torus_radius = Slider(1.16, range=0..10)
u_division = Slider(8, range=0..50)
v_division = Slider(8, range=0..50)
inside_scale = Slider(0.8, range=0..2)
pipe_radius = Slider(0.028, range=0..1)
pipe_cap = BooleanToggle(True)
cluster = Cluster(
    a=tube_radius,
    b=torus_radius,
    U=u_division,
    V=v_division,
    A=tube_radius,
    B=inside_scale,
    b_2=torus_radius,
    U_2=u_division,
    V_2=v_division)  # -> L, L_2, L_5, L_3, L_6, L_7, L_4, L_8, L_9
pipe = Pipe(
    Curve=[cluster.L, cluster.L_2, cluster.L_5, cluster.L_3, cluster.L_6, cluster.L_7, cluster.L_4, cluster.L_8, cluster.L_9],
    Radius=pipe_radius,
    Caps=pipe_cap)

# ==== cluster Cluster
A = ClusterInput()
B = ClusterInput()
a = ClusterInput()
b = ClusterInput()
b_2 = ClusterInput()
multiplication = Multiplication(A=A, B=B)
torus = CSharpScript(a=a, b=b)  # -> A
# ---------- torus: C# ----------
    double minorRadius = (double) a;
    double majorRadius = (double) b;

    A = new Rhino.Geometry.Torus(Rhino.Geometry.Plane.WorldXY, majorRadius, minorRadius).ToNurbsSurface();
# ---------- end torus ----------
torus_2 = CSharpScript(a=multiplication, b=b_2)  # -> A
# ---------- torus_2: C# ----------
    double minorRadius = (double) a;
    double majorRadius = (double) b;
    
    A = new Rhino.Geometry.Torus(Rhino.Geometry.Plane.WorldXY, majorRadius, minorRadius).ToNurbsSurface();
# ---------- end torus_2 ----------
U = ClusterInput()
V = ClusterInput()
U_2 = ClusterInput()
V_2 = ClusterInput()
sdivide = DivideSurface(Surface=torus, UCount=U, VCount=V)  # -> Points, Normals, Parameters
sdivide_2 = DivideSurface(Surface=torus_2, UCount=U_2, VCount=V_2)  # -> Points, Normals, Parameters
relitem = RelativeItem(Tree=sdivide.Points, Offset="{0;0;0}(1)", WrapPaths=True, WrapItems=True)  # -> ItemA, ItemB
relitem_2 = RelativeItem(Tree=sdivide.Points, Offset="{0;0;+1}(0)", WrapPaths=True, WrapItems=True)  # -> ItemA, ItemB
relitem_3 = RelativeItem(Tree=sdivide.Points, Offset="{0;0;-1}(0)", WrapPaths=True, WrapItems=True)  # -> ItemA, ItemB
relitem_4 = RelativeItem(Tree=sdivide_2.Points, Offset="{0;0;0}(1)", WrapPaths=True, WrapItems=True)  # -> ItemA, ItemB
relitem_5 = RelativeItem(Tree=sdivide_2.Points, Offset="{0;0;+1}(0)", WrapPaths=True, WrapItems=True)  # -> ItemA, ItemB
relitem_6 = RelativeItem(Tree=sdivide_2.Points, Offset="{0;0;-1}(0)", WrapPaths=True, WrapItems=True)  # -> ItemA, ItemB
ln = Line(StartPoint=relitem.ItemA, EndPoint=relitem.ItemB)
ln_2 = Line(StartPoint=relitem_2.ItemA, EndPoint=relitem_2.ItemB)
L = ClusterOutput(ln)
L_2 = ClusterOutput(ln_2)
ln_3 = Line(StartPoint=relitem_4.ItemA, EndPoint=relitem_4.ItemB)
ln_4 = Line(StartPoint=relitem_5.ItemA, EndPoint=relitem_5.ItemB)
L_3 = ClusterOutput(ln_3)
L_4 = ClusterOutput(ln_4)
ln_5 = Line(StartPoint=relitem.ItemA, EndPoint=relitem_4.ItemA)
ln_6 = Line(StartPoint=relitem.ItemB, EndPoint=relitem_5.ItemB)
ln_7 = Line(StartPoint=relitem.ItemB, EndPoint=relitem_6.ItemB)
ln_8 = Line(StartPoint=relitem_3.ItemB, EndPoint=relitem_4.ItemB)
ln_9 = Line(StartPoint=relitem_2.ItemB, EndPoint=relitem_4.ItemB)
L_5 = ClusterOutput(ln_5)
L_6 = ClusterOutput(ln_6)
L_7 = ClusterOutput(ln_7)
L_8 = ClusterOutput(ln_8)
L_9 = ClusterOutput(ln_9)
